# Grasshopper definition 01_Accord.gh (Grasshopper 1.0.7)
# plug-ins: Bifocals, LunchBoxML, ShapeDiverForGrasshopper, LunchBox

sddp = ShapeDiverDocumentPayload({AbsoluteTolerance=0, AngleTolerance=0, DistanceDisplayPrecision=0, GltfVersion="Gltf2", InputGroups="{}", OutputGroups="{}", RelativeTolerance=0, UnitSystem=0, VersionCreated="1.13.1.0", VersionSaved="1.13.1.0"})
# 01_Regression
gallery = ImageGallery(CycleDelay=30, Randomize=False, UseLocalImages=True, UseRemoteImages=True)

# ----
# A. Linear
number_slider = Slider(29, range=0..30)
expression = Expression(x=number_slider, Expression="23*x-89")
panel = Panel(expression)
panel_2 = Panel("""87
33
124
125
93
10
148
182
61
139
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""")
panel_3 = Panel("""1912
670
2763
2786
2050
141
3315
4097
1314
3108
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""")
linereg = LinearRegression(TestData=Slider(29, range=0..30), TrainingInputs=panel_2, TrainingOutput=panel_3, RandomSeed=5)
panel_4 = Panel(linereg)

number_slider_2 = Slider(8, range=3..8)
number_slider_3 = Slider(4.5, range=2.5..4.5)
number_slider_4 = Slider(6, range=3..6)

# ----
# 04_Neural Network
path = FilePath("C:\Users\ykish\Documents\GitHub\GEL_GH_Archive\026_LunchBOXML\Activities\roomActivities_Numerical.csv")
file = ReadFile(File=path, PerLineParse=True)
csv = ReadCSV(CSVString=file, Delimiter=",")  # -> Headers, Values

pt = Point([Point(34.20728128, 73.73443503, 0), Point(40.39614184, 75.2647454, 0), Point(44.08557545, 62.231323, 0), Point(37.14213603, 60.56890059, 0), Point(41.35429063, 68.15846557, 0), Point(54.22966499, 70.68243322, 0)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])
pdecon = Deconstruct(Point=pt)  # -> XComponent, YComponent, ZComponent
range = Range(Domain=Slider(100, range=0..100), Steps=Slider(3, range=0..10))
linereg_2 = LinearRegression(TestData=range, TrainingInputs=pdecon.XComponent, TrainingOutput=pdecon.YComponent, RandomSeed=5)
pt_2 = ConstructPoint(XCoordinate=range, YCoordinate=linereg_2, ZCoordinate=0)
pline = PolyLine(Vertices=pt_2, Closed=False)
preview = CustomPreview(
    Geometry=pline,
    Material={diffuse=RGB(221, 160, 221), emission=RGB(66, 48, 66), shine=0.5, specular=RGB(255, 255, 255), transparency=0})

# ----
# D. Multivariate Linear Regression
number_slider_5 = Slider(30, range=0..100)
x = Panel("""56.046355
52.369907
145.152473
93.645256
87.324424
82.596101
36.689868
23.75635
121.298058
131.299041
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""")
y = Panel("""69.658376
188.245494
62.921194
153.724582
91.092332
57.533269
152.375286
97.453807
139.891765
118.61024
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""")
z = Panel("""-164.540795
-646.242163
40.620169
-425.607815
-187.72048
-62.940875
-534.121407
-340.302529
-314.970944
-209.84288
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""")
series = Series(Start=0, Step=number_slider_5, Count=10)
series_2 = Series(Start=0, Step=number_slider_5, Count=10)
merge = Merge(Data1=graft(x), Data2=graft(y))
merge_2 = Merge(Data1=graft(series_2), Data2=graft(series))
multilinereg = MultivariateLinearRegression(TestData=simplify(merge_2), Inputs=simplify(merge), Output=simplify(graft(z)), RandomSeed=5)
pt_3 = ConstructPoint(XCoordinate=graft(series_2), YCoordinate=graft(series), ZCoordinate=graft(multilinereg))
preview_2 = CustomPreview(Geometry=pt_3, Material=ColourSwatch(SwatchColor=RGB(0, 144, 255)))

# ----
# C. Nonlinear
number_slider_6 = Slider(3, range=0..30)
x_2 = Panel("""87
33
124
125
93
10
148
182
61
139
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""")
y_2 = Panel("""15.911262
-3.785897
-3.9745
-1.591726
2.986906
20.195304
18.91805
-14.515988
-4.3719
23.32818
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""")
pt_4 = ConstructPoint(XCoordinate=x_2, YCoordinate=y_2, ZCoordinate=0)
nonlinereg = NonlinearRegression(
    TestData=number_slider_6,
    TrainingInputs=simplify(graft(x_2)),
    TrainingOutput=y_2,
    Sigma=Slider(24, range=0..100),
    Complexity=100,
    RandomSeed=5)  # -> Result, Score, Error
pt_5 = ConstructPoint(XCoordinate=number_slider_6, YCoordinate=nonlinereg.Result, ZCoordinate=0)
preview_3 = CustomPreview(Geometry=pt_5, Material=ColourSwatch(SwatchColor=RGB(0, 144, 255)))
panel_5 = Panel(nonlinereg.Error)

path_2 = FilePath("C:\Users\ykish\Documents\GitHub\GEL_GH_Archive\026_LunchBOXML\Activities\roomActivities_NN.bin")
load_model = LoadSavedModel(FilePath=path_2)

# ----
# 02_Clustering
# E. K-means / Gaussian Mixture
geo = Geometry(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)
number_slider_7 = Slider(10, range=0..10)
srf = Surface(geo)
popgeo = PopulateGeometry(Geometry=srf, Count=100, Seed=1)
pdecon_2 = Deconstruct(Point=popgeo)  # -> XComponent, YComponent, ZComponent
merge_3 = Merge(Data1=graft(pdecon_2.XComponent), Data2=graft(pdecon_2.YComponent))  # -> simplify(Result)
gaussianmix = GaussianMixture(TrainingInputs=merge_3, Components=number_slider_7, RandomSeed=5)  # -> Result, Likelihood, Probability
k_means = KMeansClustering(TrainingInputs=merge_3, OfClusters=number_slider_7, RandomSeed=5)  # -> Result, Likelihood, Centroids
gradient = Gradient(
    LowerLimit=0,
    UpperLimit=expr("x-1", number_slider_7),
    Parameter=gaussianmix.Result,
    stops=[0: RGB(243, 57, 0), 0.1: RGB(236, 27, 60), 0.2: RGB(210, 0, 118), 0.3: RGB(103, 0, 120), 0.5: RGB(1, 192, 229), 0.539: RGB(39, 72, 161), 0.6: RGB(18, 178, 90), 0.7: RGB(79, 186, 8), 0.8: RGB(220, 237, 32), 0.9: RGB(247, 159, 20), 1: RGB(243, 57, 0)])
gradient_2 = Gradient(
    LowerLimit=0,
    UpperLimit=expr("x-1", number_slider_7),
    Parameter=k_means.Result,
    stops=[0: RGB(243, 57, 0), 0.1: RGB(236, 27, 60), 0.2: RGB(210, 0, 118), 0.3: RGB(103, 0, 120), 0.5: RGB(1, 192, 229), 0.539: RGB(39, 72, 161), 0.6: RGB(18, 178, 90), 0.7: RGB(79, 186, 8), 0.8: RGB(220, 237, 32), 0.9: RGB(247, 159, 20), 1: RGB(243, 57, 0)])
preview_4 = CustomPreview(Geometry=popgeo, Material=gradient)
preview_5 = CustomPreview(Geometry=popgeo, Material=gradient_2)

srf_2 = Surface(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)
quads = QuadPanels(Surface=srf_2, UDivisions=Slider(25, range=0..100), VDivisions=Slider(22, range=0..100))

# ----
# 03_Classification
number_slider_8 = Slider(10, range=0..10)
panel_6 = Panel("roomActivities.csv")

number_slider_9 = Slider(5.063, range=0..10)
number_slider_10 = Slider(5.084, range=0..10)
number_slider_11 = Slider(5.214, range=0..10)

path_3 = FilePath("C:\Users\ykish\Documents\GitHub\GEL_GH_Archive\026_LunchBOXML\Activities\roomActivities.csv")
file_2 = ReadFile(File=path_3, PerLineParse=True)
csv_2 = ReadCSV(CSVString=file_2, Delimiter=",")  # -> Headers, Values

path_4 = FilePath("C:\Users\ykish\Documents\GitHub\GEL_GH_Archive\026_LunchBOXML\Activities\roomActivities.bin")
load_model_2 = LoadSavedModel(FilePath=path_4)

rectangle = Rectangle(Plane=PlaneXY(0, 0, 0), XSize=number_slider_9, YSize=number_slider_11, Radius=0)  # -> Rectangle, Length
boxrec = BoxRectangle(Rectangle=rectangle.Rectangle, Height=number_slider_10)
area = Area(Geometry=boxrec)  # -> Area, Centroid

python = GhPythonScript(x=number_slider_9)  # -> out, a
# ---------- python: Python ----------
__author__ = "ykish"
__version__ = "2023.11.23"

import rhinoscriptsyntax as rs

def classify_size(value):
    if value <= 2.5:
        return "Very Small"
    elif value <= 4.0:
        return "Small"
    elif value <= 5.5:
        return "Medium"
    elif value <= 7.0:
        return "Large"
    else:
        return "Very Large"
        
a = classify_size(x)
# ---------- end python ----------
python_2 = GhPythonScript(x=number_slider_11)  # -> out, a; same code as python
python_3 = GhPythonScript(x=number_slider_10)  # -> out, a; same code as python
python_4 = GhPythonScript(x=Slider(3, range=1..5))  # -> out, a
# ---------- python_4: Python ----------
__author__ = "ykish"
__version__ = "2023.11.23"

import rhinoscriptsyntax as rs

def classify_air_conditioning(value):
    if value == 1:
        return "Very Low"
    elif value == 2:
        return "Low"
    elif value == 3:
        return "Medium"
    elif value == 4:
        return "High"
    else:
        return "Very High"
        
a = classify_air_conditioning(x)
# ---------- end python_4 ----------
panel_7 = Panel(python.a)
panel_8 = Panel(python_2.a)
panel_9 = Panel(python_3.a)
panel_10 = Panel(python_4.a)

rectangle_2 = Rectangle(Plane=PlaneXY(0, 0, 0), XSize=number_slider_2, YSize=number_slider_4, Radius=0)  # -> Rectangle, Length
boxrec_2 = BoxRectangle(Rectangle=rectangle_2.Rectangle, Height=number_slider_3)
X = UnitX(Factor=Slider(10, range=0..10))
move = Move(Geometry=boxrec_2, Motion=X)  # -> Geometry, Transform
area_2 = Area(Geometry=move.Geometry)  # -> Area, Centroid

bang = ExplodeTree(Data=csv.Values)  # -> Branch0, Branch1, Branch2, Branch3, Branch4
rectangle_3 = Rectangle(Plane=PlaneXY(0, 0, 0), XSize=bang.Branch0, YSize=bang.Branch1, Radius=0)  # -> Rectangle, Length
boxrec_3 = BoxRectangle(Rectangle=rectangle_3.Rectangle, Height=bang.Branch2)

bnd = Bounds(Numbers=flatten(bang.Branch0))
bnd_2 = Bounds(Numbers=flatten(bang.Branch1))
bnd_3 = Bounds(Numbers=flatten(bang.Branch2))
bnd_4 = Bounds(Numbers=flatten(bang.Branch3))
remap = RemapNumbers(Value=number_slider_2, Source=bnd, Target=Domain(0, 1))  # -> Mapped, Clipped
remap_2 = RemapNumbers(Value=number_slider_4, Source=bnd_2, Target=Domain(0, 1))  # -> Mapped, Clipped
remap_3 = RemapNumbers(Value=number_slider_3, Source=bnd_3, Target=Domain(0, 1))  # -> Mapped, Clipped
remap_4 = RemapNumbers(Value=Slider(4, range=1..5), Source=bnd_4, Target=Domain(0, 1))  # -> Mapped, Clipped
merge_4 = Merge(Data1=remap.Clipped, Data2=remap_2.Clipped, Data3=remap_3.Clipped, Data4=remap_4.Clipped)

area_3 = Area(Geometry=quads)  # -> Area, Centroid

# ----
# Color Format
# Input
data = Data(1)
# Method
data_2 = Data(1)
# Output
data_3 = Data(1)
# Display
data_4 = Data(1)
# Unuse
data_5 = Data(1)

codify_data = CodifyData(Label="Length", Data=panel_7, DataType=1)

dim = Dimensions(Surface=quads)  # -> UDimension, VDimension

codify_data_2 = CodifyData(Label="Height", Data=panel_9, DataType=1)

codify_data_3 = CodifyData(Label="AirConditioning", Data=panel_10, DataType=1)

lng = ListLength(List=bang.Branch2)
range_2 = Range(Domain=Slider(74, range=0..100), Steps=lng)
Y = UnitY(Factor=range_2)

codify_data_4 = CodifyData(Label="Width", Data=panel_8, DataType=1)

srf_cp = SurfaceClosestPoint(Point=area_3.Centroid, Surface=quads)  # -> Point, UVPoint, Distance
evalsrf = EvaluateSurface(Surface=quads, Point=srf_cp.UVPoint)  # -> Point, Normal, UDirection, VDirection, Frame
pdecon_3 = Deconstruct(Point=evalsrf.Normal)  # -> XComponent, YComponent, ZComponent

flat = FlatnessCheck(PanelList=quads)  # -> FlatPanels, Planes, Deviations

index = ItemIndex(List=bang.Branch4, Item=bang.Branch4)
txt = Text(flatten(index))
bnd_5 = Bounds(Numbers=flatten(txt))
remap_5 = RemapNumbers(Value=txt, Source=bnd_5, Target=Domain(0, 1))  # -> Mapped, Clipped

flip = FlipMatrix(Data=csv.Values)
split = SplitList(List=flip, Index=Slider(4, range=0..10))  # -> ListA, ListB

panel_11 = Panel(remap_5.Mapped)

merge_5 = Merge(Data1=codify_data, Data2=codify_data_4, Data3=codify_data_2, Data4=codify_data_3)
naive_bayes_classification_tester = NaiveBayesClassificationTester(NaiveBayesClassifier=load_model_2, TestInputData=merge_5)  # -> Classifications, Probabilties

merge_6 = Merge(
    Data1=simplify(graft(dim.UDimension)),
    Data2=simplify(graft(dim.VDimension)),
    Data3=simplify(graft(area_3.Area)),
    Data4=simplify(graft(flat.Deviations)))
gaussianmix_2 = GaussianMixture(TrainingInputs=merge_6, Components=number_slider_8, RandomSeed=5)  # -> Result, Likelihood, Probability
gradient_3 = Gradient(
    LowerLimit=0,
    UpperLimit=expr("x-1", number_slider_8),
    Parameter=gaussianmix_2.Result,
    stops=[0: RGB(243, 57, 0), 0.1: RGB(236, 27, 60), 0.2: RGB(210, 0, 118), 0.3: RGB(103, 0, 120), 0.4: RGB(39, 72, 161), 0.5: RGB(1, 192, 229), 0.6: RGB(18, 178, 90), 0.7: RGB(79, 186, 8), 0.8: RGB(220, 237, 32), 0.9: RGB(247, 159, 20), 1: RGB(243, 57, 0)])
preview_6 = CustomPreview(Geometry=quads, Material=gradient_3)

k_means_2 = KMeansClustering(TrainingInputs=merge_6, OfClusters=number_slider_8, RandomSeed=5)  # -> Result, Likelihood, Centroids
gradient_4 = Gradient(
    LowerLimit=0,
    UpperLimit=expr("x-1", number_slider_8),
    Parameter=k_means_2.Result,
    stops=[0: RGB(243, 57, 0), 0.1: RGB(236, 27, 60), 0.2: RGB(210, 0, 118), 0.3: RGB(103, 0, 120), 0.4: RGB(39, 72, 161), 0.5: RGB(1, 192, 229), 0.6: RGB(18, 178, 90), 0.7: RGB(79, 186, 8), 0.8: RGB(220, 237, 32), 0.9: RGB(247, 159, 20), 1: RGB(243, 57, 0)])
preview_7 = CustomPreview(Geometry=quads, Material=gradient_4)

move_2 = Move(Geometry=boxrec_3, Motion=Y)  # -> Geometry, Transform
gradient_5 = Gradient(
    LowerLimit=0,
    UpperLimit=1,
    Parameter=remap_5.Mapped,
    stops=[0: RGB(243, 57, 0), 0.1: RGB(236, 27, 60), 0.2: RGB(210, 0, 118), 0.3: RGB(103, 0, 120), 0.4: RGB(39, 72, 161), 0.5: RGB(1, 192, 229), 0.6: RGB(18, 178, 90), 0.7: RGB(79, 186, 8), 0.8: RGB(220, 237, 32), 0.9: RGB(247, 159, 20), 1: RGB(243, 57, 0)])
preview_8 = CustomPreview(Geometry=move_2.Geometry, Material=gradient_5)

# ----
# The formula is not linear. So it won't work well.
number_slider_12 = Slider(20, range=0..30)
expression_2 = Expression(x=number_slider_12, Expression="Sin(2*x)*25")

area_4 = Area(Geometry=move_2.Geometry)  # -> Area, Centroid
tag = TextTag(Location=area_4.Centroid, Text=bang.Branch4)

number_slider_13 = Slider(200, range=0..1000)
number_slider_14 = Slider(200, range=0..1000)
random = Random(Range=number_slider_14, Number=number_slider_13, Seed=Slider(38, range=0..100))
random_2 = Random(Range=number_slider_14, Number=number_slider_13, Seed=Slider(330, range=0..1000))
expression_3 = Expression(x=random_2, y=random, Expression="2*x-4*y+2")
pt_6 = ConstructPoint(XCoordinate=random_2, YCoordinate=random, ZCoordinate=expression_3)
pt_7 = ConstructPoint(XCoordinate=random_2, YCoordinate=random, ZCoordinate=expression_3)
reduce = RandomReduce(List=pt_6, Reduction=Slider(100, range=0..100), Seed=1)
pdecon_4 = Deconstruct(Point=reduce)  # -> XComponent, YComponent, ZComponent
preview_9 = CustomPreview(Geometry=pt_7, Material=ColourSwatch(SwatchColor=RGB(227, 0, 0)))
panel_12 = Panel(pdecon_4.XComponent)
panel_13 = Panel(pdecon_4.YComponent)
panel_14 = Panel(pdecon_4.ZComponent)

number_slider_15 = Slider(100, range=0..100)
series_3 = Series(Start=0, Step=1, Count=Slider(200, range=0..1000))
expression_4 = Expression(x=series_3, Expression="Sin(0.1*x)*24")
reduce_2 = RandomReduce(List=series_3, Reduction=number_slider_15, Seed=1)
panel_15 = Panel(reduce_2)
pt_8 = ConstructPoint(XCoordinate=series_3, YCoordinate=expression_4, ZCoordinate=0)
reduce_3 = RandomReduce(List=expression_4, Reduction=number_slider_15, Seed=1)
panel_16 = Panel(reduce_3)
preview_10 = CustomPreview(Geometry=pt_8, Material=ColourSwatch(SwatchColor=RGB(227, 0, 0)))
panel_17 = Panel(expression_4)

# ----
# Test
panel_18 = Panel(naive_bayes_classification_tester.Classifications)

number_slider_16 = Slider(100, range=0..100)
series_4 = Series(Start=0, Step=1, Count=Slider(200, range=0..1000))
expression_5 = Expression(x=series_4, Expression="23*x-89")
reduce_4 = RandomReduce(List=series_4, Reduction=number_slider_16, Seed=1)
panel_19 = Panel(reduce_4)
panel_20 = Panel(expression_5)
reduce_5 = RandomReduce(List=expression_5, Reduction=number_slider_16, Seed=1)
panel_21 = Panel(reduce_5)

# ----
# B. Logistic
number_slider_17 = Slider(375, range=0..1000)
srf_3 = Surface(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)
srf_4 = Surface(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)
srf_5 = Surface(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)
popgeo_2 = PopulateGeometry(Geometry=srf_4, Count=number_slider_17, Seed=1)
popgeo_3 = PopulateGeometry(Geometry=srf_3, Count=number_slider_17, Seed=1)
popgeo_4 = PopulateGeometry(Geometry=srf_5, Count=Slider(225, range=0..1000), Seed=1)  # -> graft(Population)
merge_7 = Merge(Data1=flatten(popgeo_3), Data2=flatten(popgeo_2))
lng_2 = ListLength(List=popgeo_3)
lng_3 = ListLength(List=popgeo_2)
pdecon_5 = Deconstruct(Point=merge_7)  # -> XComponent, YComponent, ZComponent
dup = DuplicateData(Data=Toggle(False), Number=lng_2, Order=True)
dup_2 = DuplicateData(Data=Toggle(True), Number=lng_3, Order=True)
merge_8 = Merge(Data1=graft(pdecon_5.XComponent), Data2=graft(pdecon_5.YComponent))  # -> simplify(Result)
merge_9 = Merge(Data1=dup, Data2=dup_2)  # -> simplify(Result)

pdecon_6 = Deconstruct(Point=popgeo_4)  # -> XComponent, YComponent, ZComponent
merge_10 = Merge(Data1=graft(pdecon_6.XComponent), Data2=graft(pdecon_6.YComponent))  # -> simplify(Result)
panel_22 = Panel(merge_8)

logreg = LogisticRegression(
    TestData=merge_10,
    TrainingInputs=merge_8,
    TrainingOutput=merge_9,
    Tolerance=Slider(0.4684, range=0..1),
    MaximumIterations=100,
    RegularizationValue=Slider(0.4644, range=0..10),
    RandomSeed=Slider(59, range=0..100))  # -> Result, Score
gradient_6 = Gradient(LowerLimit=0, UpperLimit=1, Parameter=graft(logreg.Score), stops=[0: RGB(234, 38, 0), 1: RGB(75, 107, 169)])
panel_23 = Panel(logreg.Score)
preview_11 = CustomPreview(Geometry=popgeo_4, Material=gradient_6)

# ----
# Training
bang_2 = ExplodeTree(Data=csv_2.Values)  # -> Branch0, Branch1, Branch2, Branch3, Branch4
panel_24 = Panel(bang_2.Branch4)
item = ListItem(List=csv_2.Headers, Index=0, Wrap=True)  # -> Item, Item1, Item2, Item3, Item4
panel_25 = Panel(item.Item4)
panel_26 = Panel(item.Item3)
length = Panel(bang_2.Branch0)
panel_27 = Panel(item.Item)
width = Panel(bang_2.Branch1)
height = Panel(bang_2.Branch2)
airconditioning = Panel(bang_2.Branch3)
activity = Panel(bang_2.Branch4)
txt_2 = Text(width)
txt_3 = Text(length)
txt_4 = Text(height)
txt_5 = Text(airconditioning)
codify_data_5 = CodifyData(Label=item.Item2, Data=txt_4, DataType=1)
codify_data_6 = CodifyData(Label=item.Item1, Data=txt_2, DataType=1)
codify_data_7 = CodifyData(Label=panel_27, Data=txt_3, DataType=1)
codify_data_8 = CodifyData(Label=item.Item3, Data=txt_5, DataType=2)
merge_11 = Merge(Data1=codify_data_7, Data2=codify_data_6, Data3=codify_data_5, Data4=codify_data_8)

txt_6 = Text(activity)

codify_data_9 = CodifyData(Label=item.Item4, Data=txt_6, DataType=1)
naive_bayes_classification_trainer = NaiveBayesClassificationTrainer(TrainingInputs=merge_11, TrainingClassifications=codify_data_9)

cset = CreateSet(List=activity)  # -> Set, Map
lng_4 = ListLength(List=cset.Set)
tmatch = MatchText(Text=naive_bayes_classification_tester.Classifications, Pattern=cset.Set, Case=True)
range_3 = Range(Domain=Domain(0, 1), Steps=expr("x-1", lng_4))
cull = CullPattern(List=range_3, CullPattern=tmatch)

gradient_7 = Gradient(
    LowerLimit=0,
    UpperLimit=1,
    Parameter=cull,
    stops=[0: RGB(243, 57, 0), 0.1: RGB(236, 27, 60), 0.2: RGB(210, 0, 118), 0.3: RGB(103, 0, 120), 0.4: RGB(39, 72, 161), 0.5: RGB(1, 192, 229), 0.6: RGB(18, 178, 90), 0.7: RGB(79, 186, 8), 0.8: RGB(220, 237, 32), 0.9: RGB(247, 159, 20), 1: RGB(243, 57, 0)])
tag_2 = TextTag(Location=area.Centroid, Text=naive_bayes_classification_tester.Classifications)
preview_12 = CustomPreview(Geometry=boxrec, Material=gradient_7)

item_2 = ListItem(List=split.ListA, Index=0, Wrap=True)  # -> Item, Item1, Item2, Item3, Item4

bnd_6 = Bounds(Numbers=flatten(bang.Branch0))
bnd_7 = Bounds(Numbers=flatten(bang.Branch1))
bnd_8 = Bounds(Numbers=flatten(bang.Branch2))
bnd_9 = Bounds(Numbers=flatten(bang.Branch3))
remap_6 = RemapNumbers(Value=item_2.Item, Source=bnd_6, Target=Domain(0, 1))  # -> Mapped, Clipped
remap_7 = RemapNumbers(Value=item_2.Item1, Source=bnd_7, Target=Domain(0, 1))  # -> Mapped, Clipped
remap_8 = RemapNumbers(Value=item_2.Item2, Source=bnd_8, Target=Domain(0, 1))  # -> Mapped, Clipped
remap_9 = RemapNumbers(Value=item_2.Item3, Source=bnd_9, Target=Domain(0, 1))  # -> Mapped, Clipped

merge_12 = Merge(Data1=remap_6.Mapped, Data2=remap_7.Mapped, Data3=remap_8.Mapped, Data4=remap_9.Mapped)

panel_28 = Panel(merge_12)
neural_network_trainer = NeuralNetworkTrainer(
    TrainingInputs=simplify(merge_12),
    TrainingOutputs=simplify(graft(panel_11)),
    HiddenNeurons=6,
    LearningAlgorithm=Slider(1, range=0..10),
    ActivationFunction=0,
    Alpha=2,
    Iterations=500)  # -> TrainedNueralNetwork, ErrorsDynamics

neural_network_tester = NeuralNetworkTester(TrainedNeuralNetwork=neural_network_trainer.TrainedNueralNetwork, TestInputData=merge_4)

remap_10 = RemapNumbers(Value=neural_network_tester, Source=Domain(0, 1), Target=bnd_5)  # -> Mapped, Clipped
panel_29 = Panel(remap_10.Mapped)
item_3 = ListItem(List=bang.Branch4, Index=remap_10.Mapped, Wrap=True)
tag_3 = TextTag(Location=area_2.Centroid, Text=item_3)

gradient_8 = Gradient(
    LowerLimit=0,
    UpperLimit=1,
    Parameter=neural_network_tester,
    stops=[0: RGB(243, 57, 0), 0.1: RGB(236, 27, 60), 0.2: RGB(210, 0, 118), 0.3: RGB(103, 0, 120), 0.4: RGB(39, 72, 161), 0.5: RGB(1, 192, 229), 0.6: RGB(18, 178, 90), 0.7: RGB(79, 186, 8), 0.8: RGB(220, 237, 32), 0.9: RGB(247, 159, 20), 1: RGB(243, 57, 0)])
preview_13 = CustomPreview(Geometry=move.Geometry, Material=gradient_8)

panel_30 = Panel(item_3)
